# Grasshopper definition 00_FileImport_r8_202405.gh (Grasshopper 1.0.8)
# plug-ins: RhinoCodePluginGH, LunchBox, Kangaroo2 Components, eleFront, Wombat

path = FilePath("C:\Users\joshu\viktor-apps\Rapid-Prototyper\3dm_upload_tests\GOCH_20240123_v6.3dm")  # disabled
panel = Panel("*##_*_##*")  # disabled
number_slider = Slider(1, range=0..2)  # disabled
uploadactive = BooleanToggle(True)  # disabled

number_slider_2 = Slider(2, range=0..2)  # disabled
toggle = BooleanToggle(True)  # disabled
# G:\Shared drives\Climetric\Projects\MalanVorster_House Scheufen\Models_Thermal\ARCH - House Scheufen_CLIMETRIC MODEL_DolfEdit_20231208_cleaned_exploded_baked.3dm
path_2 = FilePath("G:\Shared drives\Climetric\Projects\Climetric_Geodan_PalingStraat\Drawings\PalingstraatTests_20240301\Palingstraat_02_shrinkwrapped.3dm")  # disabled
panel_2 = Panel("*##_*_##*")  # disabled
optional_alternative_roomname_search_pat = GetString(panel, AtLeast=0, AtMost=1, Prompt="Default = \"*##_*_##*", TreeAccess=False)  # "Optional alternative roomname search pattern"
room_names_0_auto_1_blocknames_2_layersn = GetInteger(number_slider, AtLeast=1, AtMost=1, Maximum=2147483647, Minimum=-2147483648, TreeAccess=False)  # "Room names: 0 = auto, 1 = blocknames, 2 = layersnames"
run_script = GetBoolean(uploadactive, AtLeast=1, AtMost=1, FalseValue="False", TreeAccess=False, TrueValue="True")
file_path = GetFilePath(path, AtLeast=1, AtMost=1, TreeAccess=False)
bool = Boolean(run_script)
panel_3 = Panel(run_script)
S = Script(x=bool)  # -> out, a
# ---------- S: Python ----------
"""Grasshopper Script"""
a = ""
if x:
    a = "I ran on the server!"
else:
    a = "Wtf is going on"
# ---------- end S ----------
panel_4 = Panel(S.a)
panel_5 = Panel(path)

lng = ListLength(List=optional_alternative_roomname_search_pat)
filter = StreamFilter(Gate=lng, Stream0="*##_*_##*", Stream1=optional_alternative_roomname_search_pat)

py3 = Python3Script(file_path=file_path, run_script=run_script)  # -> out, names, layers, geometries
# ---------- py3: Python ----------
import Rhino

def read_3dm_file(file_path):
    # Read the file
    file = Rhino.FileIO.File3dm.Read(file_path)
    
    if file is None:
        print("Unable to read", file_path)
        return None, None, None
    
    # Read geometries and names
    geometries = [obj.Geometry for obj in file.Objects]
    names = [obj.Attributes.Name for obj in file.Objects]
    
    # Read layer names in a manner that avoids the subscripting issue:
    layer_indices = [obj.Attributes.LayerIndex for obj in file.Objects]
    layers = [file.AllLayers.FindIndex(index).Name for index in layer_indices]

    return geometries, layers, names

# Set file_path as your .3dm file path.
#file_path = "path_to_your_file.3dm"

# Initialize outputs
geometries, layers, names = [], [], []

# Assume a run_script boolean toggle connected in Grasshopper.
#run_script = True

if run_script:
    geometries, layers, names = read_3dm_file(file_path)
# ---------- end py3 ----------
tmatch = MatchText(Text=py3.names, Pattern="*glazing*", Case=Toggle(True))
cull = CullPattern(List=py3.geometries, CullPattern=tmatch)
panel_6 = Panel(py3.out)
panel_7 = Panel(py3.layers)
panel_8 = Panel(py3.names)
panel_9 = Panel(py3.geometries)
cset = CreateSet(List=py3.layers)  # -> Set, Map
panel_10 = Panel(cset.Set)
toggle_2 = BooleanToggle(False)

tmatch_2 = MatchText(Text=py3.layers, Pattern="*Tree*", Case=toggle_2)
cull_2 = CullPattern(List=py3.geometries, CullPattern=tmatch_2)

# ---- group: I'm finding Context Blocks with Names
null = NullItem(Item=py3.names)  # -> NullFlags, InvalidFlags, Description
or = GateOr(A=null.NullFlags, B=tmatch_2)
cull_3 = CullPattern(List=py3.geometries, CullPattern=invert(or))
cull_4 = CullPattern(List=py3.names, CullPattern=invert(or))

# ----
tmatch_3 = MatchText(Text=py3.layers, Pattern="*Terrain*", Case=toggle_2)
cull_5 = CullPattern(List=py3.geometries, CullPattern=tmatch_3)

explode = ExplodeObject(Object=cull_2, Recursive=False)  # -> flatten(Objects)
area = Area(Geometry=explode)  # -> Area, Centroid
not = GateNot(A=tmatch_2)
sort_pts = SortDuplicatePoints(Points=area.Centroid)  # -> UniquePoints, Indices

tmatch_4 = MatchText(Text=py3.layers, Pattern="*Door*", Case=toggle_2)
cull_6 = CullPattern(List=py3.geometries, CullPattern=tmatch_4)

not_2 = GateNot(A=tmatch_4)
filtertype = FilterByType(ObjectType="Brep", Geometry=cull_2, invertFilter=False, returnNulls=False)  # -> ExcludedGeometry, IncludedGeometry
panel_11 = Panel(not)
filtertype_2 = FilterByType(ObjectType="Mesh", Geometry=cull_5, invertFilter=False, returnNulls=False)  # -> ExcludedGeometry, IncludedGeometry
filtertype_3 = FilterByType(ObjectType="Brep", Geometry=cull_5, invertFilter=False, returnNulls=False)  # -> ExcludedGeometry, IncludedGeometry

nullrep = ReplaceNulls(Items=py3.names, Replacements="no_name")  # -> Items, Count

mesh = MeshBrep(
    Brep=filtertype_3.IncludedGeometry,
    Settings={GridMaxCount=0, GridMinCount=16, JaggedSeams=False, MaxEdgeLength=0, MinEdgeLength=0.0001, MinTolerance=0, Refine=True, RefineAngle=0, RelativeTolerance=0.65, SimplePlanes=True, Tolerance=0})

tmatch_5 = MatchText(Text=py3.layers, Pattern="*Glazing*", Case=toggle_2)
cull_7 = CullPattern(List=py3.geometries, CullPattern=tmatch_5)

# ---- group: Convert mesh to brep
tmatch_6 = MatchText(Text=cull_6, Pattern="*Mesh*", Case=True)
cull_8 = CullPattern(List=cull_6, CullPattern=invert(tmatch_6))
cull_9 = CullPattern(List=cull_6, CullPattern=tmatch_6)
faceb = FaceBoundaries(Mesh=cull_9)
boundary = BoundarySurfaces(Edges=faceb)  # -> flatten(Surfaces)
merge = Merge(Data1=cull_8, Data2=boundary)  # -> flatten(Result)

# ---- group: Tree names (points)
cull_10 = CullPattern(List=py3.names, CullPattern=tmatch_2)

# ----
filtertype_4 = FilterByType(ObjectType="Point", Geometry=cull_2, invertFilter=False, returnNulls=False)  # -> ExcludedGeometry, IncludedGeometry
clean = CleanTree(RemoveNulls=True, RemoveInvalid=True, RemoveEmpty=False, Tree=cull_10)

# ---- group: Convert mesh to brep
tmatch_7 = MatchText(Text=cull_7, Pattern="*Mesh*", Case=True)
cull_11 = CullPattern(List=cull_7, CullPattern=invert(tmatch_7))
cull_12 = CullPattern(List=cull_7, CullPattern=tmatch_7)
faceb_2 = FaceBoundaries(Mesh=cull_12)
boundary_2 = BoundarySurfaces(Edges=faceb_2)  # -> flatten(Surfaces)
merge_2 = Merge(Data1=cull_11, Data2=boundary_2)  # -> flatten(Result)

# ----
merge_3 = Merge(Data2=filtertype_2.IncludedGeometry, Data3=mesh)  # -> flatten(Result)
clean_2 = CleanTree(RemoveNulls=True, RemoveInvalid=True, RemoveEmpty=False, Tree=merge)
clean_3 = CleanTree(RemoveNulls=True, RemoveInvalid=True, RemoveEmpty=False, Tree=merge_2)
context_bake = ContextBake(Glazing_Geometry=clean_3)
context_bake_2 = ContextBake(All_Geometry=py3.geometries)
context_print = ContextPrint(All_Names=nullrep.Items)
context_print_2 = ContextPrint(All_Layers=py3.layers)
context_bake_3 = ContextBake(Door_Geometry=clean_2)
context_print_3 = ContextPrint(TreePointNames=clean)
context_bake_4 = ContextBake(Terrain_Mesh=merge_3)
context_print_4 = ContextPrint(ServerRun=panel_4)
context_bake_5 = ContextBake(TreePoints=filtertype_4.IncludedGeometry)

# ---- group: I find rooms based on layer names
tmatch_8 = MatchText(Text=py3.layers, Pattern=filter, Case=True)

# ----
ma = MassAddition(Input=tmatch_8)  # -> Result, PartialResults
panel_12 = Panel(ma.Result)
or_2 = GateOr(A=tmatch_8, B=tmatch_2)
not_3 = GateNot(A=or_2)

# ---- group: I find rooms based on layer names (continued)
cull_13 = CullPattern(List=py3.layers, CullPattern=or_2)
cull_14 = CullPattern(List=py3.geometries, CullPattern=or_2)

# ----
panel_13 = Panel(cull_13)

# ---- group: AUTO MODE - If context blocks don't work - I'm using layer names
lng_2 = ListLength(List=cull_4)
equals = Equality(FirstNumber=lng_2, SecondNumber="0")  # -> Equality, Inequality
filter_2 = StreamFilter(Gate=equals.Equality, Stream0=cull_4, Stream1=cull_13)
filter_3 = StreamFilter(Gate=equals.Equality, Stream0=cull_3, Stream1=cull_14)

# ----
filter_4 = StreamFilter(Gate=equals.Equality, Stream0=or, Stream1=not_3)

# ---- group: Based on input integer
filter_5 = StreamFilter(Gate=room_names_0_auto_1_blocknames_2_layersn, Stream0=filter_3, Stream1=cull_3, Stream2=cull_14)
filter_6 = StreamFilter(Gate=room_names_0_auto_1_blocknames_2_layersn, Stream0=filter_2, Stream1=cull_4, Stream2=cull_13)

# ----
tmatch_9 = MatchText(Text=filter_6, Pattern=filter, Case=True)
cull_15 = CullPattern(List=filter_5, CullPattern=tmatch_9)
cull_16 = CullPattern(List=filter_6, CullPattern=tmatch_9)
panel_14 = Panel(cull_16)
panel_15 = Panel(cull_15)
context_print_5 = ContextPrint(Room_Names=cull_16)

not_4 = GateNot(A=tmatch_5)
not_5 = GateNot(A=tmatch_3)
and = GateAnd(A=filter_4, B=not_4, D=not_2, C=not_5, E=not)
cull_17 = CullPattern(List=py3.geometries, CullPattern=and)

tmatch_10 = MatchText(Text=cull_17, Pattern="*Block Instance*", Case=toggle_2)
cull_18 = CullPattern(List=cull_17, CullPattern=invert(tmatch_10))
cull_19 = CullPattern(List=cull_17, CullPattern=tmatch_10)
merge_4 = Merge(Data1=flatten(cull_18), Data2=cull_19)

tmatch_11 = MatchText(Text=merge_4, Pattern="*Mesh*", Case=toggle_2)
cull_20 = CullPattern(List=merge_4, CullPattern=invert(tmatch_11))
cull_21 = CullPattern(List=merge_4, CullPattern=tmatch_11)
faceb_3 = FaceBoundaries(Mesh=cull_21)
tmatch_12 = MatchText(Text=cull_20, Pattern="*Curve*", Case=True)
boundary_3 = BoundarySurfaces(Edges=faceb_3)  # -> flatten(Surfaces)
cull_22 = CullPattern(List=cull_20, CullPattern=invert(tmatch_12))
merge_5 = Merge(Data1=cull_22, Data2=boundary_3)  # -> flatten(Result)
join = BrepJoin(Breps=merge_5)  # -> Breps, Closed
fmerge = MergeFaces(Brep=join.Breps)  # -> Breps, Before, After

context_bake_6 = ContextBake(Context_Geometry=fmerge.Breps)

# ---- group: Tree geometry
tmatch_13 = MatchText(Text=filtertype.IncludedGeometry, Pattern="*Untrimmed*", Case=toggle_2)
cull_23 = CullPattern(List=filtertype.IncludedGeometry, CullPattern=invert(tmatch_13))
cull_24 = CullPattern(List=filtertype.IncludedGeometry, CullPattern=tmatch_13)  # -> graft(List)
tmatch_14 = MatchText(Text=cull_23, Pattern="*Closed*", Case=toggle_2)
cull_25 = CullPattern(List=cull_23, CullPattern=tmatch_14)
mesh_2 = MeshBrep(
    Brep=cull_25,
    Settings={GridMaxCount=0, GridMinCount=16, JaggedSeams=False, MaxEdgeLength=0, MinEdgeLength=0.0001, MinTolerance=0, Refine=True, RefineAngle=0, RelativeTolerance=0.65, SimplePlanes=True, Tolerance=0})

# ----
lng_3 = ListLength(List=cull_24)
equals_2 = Equality(FirstNumber=lng_3, SecondNumber="0")  # -> Equality, Inequality
gate = StreamGate(Stream=cull_24, Gate=equals_2.Equality)  # -> Target0, Target1

# ---- group: Tree geometry (continued)
triremesh = TriRemesh(Geometry=gate.Target0, Length="2.5", Iterations=25)  # -> Triangulation, Dual, Creases
faceb_4 = FaceBoundaries(Mesh=triremesh.Triangulation)
merge_6 = Merge(Data1=flatten(mesh_2), Data2=flatten(triremesh.Triangulation))
crv = Curve(flatten(faceb_4))

# ----
lng_4 = ListLength(List=merge_3)
lng_5 = ListLength(List=fmerge.Breps)
larger = LargerThan(FirstNumber=lng_4, SecondNumber="0")  # -> LargerThan, OrEqualTo
name_from_path = FileNameFromFilePath(FilePath=file_path)  # -> Name, NameWithExtension
larger_2 = LargerThan(FirstNumber=lng_5, SecondNumber="0")  # -> LargerThan, OrEqualTo
lng_6 = ListLength(List=clean_2)
lng_7 = ListLength(List=clean_3)
lng_8 = ListLength(List=merge_6)
lng_9 = ListLength(List=cull_16)
lng_10 = ListLength(List=filtertype_4.IncludedGeometry)
filter_7 = StreamFilter(Gate=larger.LargerThan, Stream0="NO local terrain imported", Stream1="Local terrain imported")
concat = Concatenate(FragmentA=lng_6, FragmentB=" DOORS imported")
concat_2 = Concatenate(FragmentA=name_from_path.NameWithExtension, FragmentB=" imported:")
concat_3 = Concatenate(FragmentA=lng_7, FragmentB=" WINDOWS imported")
concat_4 = Concatenate(FragmentA=lng_8, FragmentB=" TREE GEOMETRIES imported")
concat_5 = Concatenate(FragmentA=lng_9, FragmentB=" ROOMS imported")
concat_6 = Concatenate(FragmentA=lng_10, FragmentB=" TREE POINTS imported")
filter_8 = StreamFilter(Gate=larger_2.LargerThan, Stream0="NO local shading context imported", Stream1="Local shading context imported")
merge_7 = Merge(
    Data1=flatten(concat_2),
    Data2=flatten(concat_5),
    Data3=flatten(concat_3),
    Data4=flatten(concat),
    Data5=flatten(concat_4),
    Data6=flatten(concat_6),
    Data7=flatten(" --- trees from points will be created in next page"),
    Data8=flatten(filter_8),
    Data9=flatten(filter_7))

panel_16 = Panel(merge_7)
context_bake_7 = ContextBake(Tree_MeshCurve=crv)
context_bake_8 = ContextBake(Tree_Mesh=merge_6)
context_print_6 = ContextPrint(ImportReport=merge_7)

tmatch_15 = MatchText(Text=cull_15, Pattern="*mesh*", Case=toggle_2)
tmatch_16 = MatchText(Text=cull_15, Pattern="*Block Instance*", Case=toggle_2)
or_3 = GateOr(A=tmatch_15, B=tmatch_16)
cull_26 = CullPattern(List=cull_15, CullPattern=tmatch_16)
cull_27 = CullPattern(List=cull_15, CullPattern=invert(or_3))
capex = CapHolesEx(Brep=cull_27)  # -> Brep, Caps, Solid
fmerge_2 = MergeFaces(Brep=capex.Brep)  # -> Breps, Before, After

# ---- group: Meshes rooms that are drawn as blocks are removed / Rooms in meshes
cull_28 = CullPattern(List=filter_6, CullPattern=tmatch_15)  # disabled

# ---- group: Meshes rooms that are drawn as blocks are removed / Rooms in Blocks
cull_29 = CullPattern(List=filter_6, CullPattern=tmatch_16)  # disabled

# ----
not_6 = GateNot(A=tmatch_16)
and_2 = GateAnd(A=tmatch_15, B=not_6)
block_instance = BlockInstance(cull_26)
explode_2 = ExplodeObject(Object=block_instance, Recursive=False)  # -> flatten(Objects)

cull_30 = CullPattern(List=cull_15, CullPattern=and_2)
merge_8 = Merge(Data1=fmerge_2.Breps, Data2=cull_30, Data3=explode_2)
clean_4 = CleanTree(RemoveNulls=True, RemoveInvalid=True, RemoveEmpty=Toggle(True), Tree=merge_8)

# ---- group: Meshes rooms that are drawn as blocks are removed
difference = SetDifference(SetA=cull_28, SetB=cull_29)  # disabled
lng_11 = ListLength(List=difference)  # disabled
tmatch_17 = MatchText(Text=cull_29, Pattern=difference, Case=True)  # disabled
panel_17 = Panel("0")  # disabled
larger_3 = LargerThan(FirstNumber=lng_11, SecondNumber=panel_17)  # -> LargerThan, OrEqualTo; disabled
cull_31 = CullPattern(List=cull_30, CullPattern=tmatch_17)  # disabled
filter_9 = StreamFilter(Gate=larger_3.LargerThan, Stream1=cull_31)  # disabled

# ----
panel_18 = Panel(explode_2)

merge_9 = Merge(Data1=block_instance, Data2=cull_19)
panel_19 = Panel("""WARNING!!! Block instances in your model.
When importing a dxf etc you will have to explode the block instances.
The grasshopper explode function does not run headless unfortunately.
A script can be made in future, but initial tries have failes :(""")
lng_12 = ListLength(List=merge_9)
larger_4 = LargerThan(FirstNumber=lng_12, SecondNumber="0")  # -> LargerThan, OrEqualTo
filter_10 = StreamFilter(Gate=larger_4.LargerThan, Stream1=panel_19)

context_bake_9 = ContextBake(Room_Geometry=clean_4)
context_print_7 = ContextPrint(WarningMessage=filter_10)
